# Grasshopper definition coordinate generator.gh (Grasshopper 1.0.7)

number_slider = Slider(35, range=0..100)
range = Range(Domain="0 to 1", Steps=number_slider)
series = Series(Start=Slider(0, range=0..100), Step=Slider(10, range=0..10), Count=expr("x+1", number_slider))

graph_mapper = GraphMapper(
    range,
    x0=0,
    x1=1,
    y0=0,
    y1=1,
    container_name="Sinc",
    Equation_X0=0.4958475232,
    Equation_X1=0.5910723805,
    Equation_Y0=0.8611682653,
    Equation_Y1=0.3075351119)
panel = Panel("HAPPY")

graph_mapper_2 = GraphMapper(
    range,
    x0=0,
    x1=1,
    y0=0,
    y1=1,
    container_name="Sinc",
    Equation_X0=0.2069410384,
    Equation_X1=0.2878822088,
    Equation_Y0=0.001633942127,
    Equation_Y1=0.765032649)
panel_2 = Panel("ANGRY")

remap_numbers = RemapNumbers(Value=graph_mapper, Source="0 to 1", Target="-50 to 50")  # -> Mapped, Clipped
power = Power(A=Slider(10, range=0..10), B=Slider(2, range=0..10))
multiplication = Multiplication(A=remap_numbers.Mapped, B=power)
round = Round(Number=multiplication)  # -> Nearest, Floor, Ceiling
division = Division(A=round.Nearest, B=power)
construct_point = ConstructPoint(XCoordinate=series, YCoordinate=division, ZCoordinate=0)
list_item = ListItem(List=division, Index=0, Wrap=True)  # -> Item, Item1, Item2, Item3, Item4, Item5, Item6, Item7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
concatenate = Concatenate(
    Fragment_A="[",
    Fragment_B=list_item.Item,
    A=", ",
    B=list_item.Item1,
    C=", ",
    D=list_item.Item2,
    E="]",
    F=", ",
    G="[",
    H=list_item.Item3,
    I=", ",
    J=list_item.Item4,
    K=", ",
    L=list_item.Item5,
    M="]",
    N=", ",
    O="[",
    P=list_item.Item6,
    Q=", ",
    R=list_item.Item7,
    S=", ",
    T=list_item.Item8,
    U="]",
    V=", ",
    W="[",
    X=list_item.Item9,
    Y=", ",
    Z=list_item.Item10,
    AA=", ",
    AB=list_item.Item11,
    AC="]",
    AD=", ",
    AE="[",
    AF=list_item.Item12,
    AG=", ",
    AH=list_item.Item13,
    AI=", ",
    AJ=list_item.Item14,
    AK="]",
    AL=", ",
    AM="[",
    AN=list_item.Item15,
    AO=", ",
    AP=list_item.Item16,
    AQ=", ",
    AR=list_item.Item17,
    AS="]",
    AT=", ",
    AU="[",
    AV=list_item.Item18,
    AW=", ",
    AX=list_item.Item19,
    AY=", ",
    AZ=list_item.Item20,
    BA="]",
    BB=", ",
    BC="[",
    BD=list_item.Item21,
    BE=", ",
    BF=list_item.Item22,
    BG=", ",
    BH=list_item.Item23,
    BI="]",
    BJ=", ",
    BK="[",
    BL=list_item.Item24,
    BM=", ",
    BN=list_item.Item25,
    BO=", ",
    BP=list_item.Item26,
    BQ="]",
    BR=", ",
    BS="[",
    BT=list_item.Item27,
    BU=", ",
    BV=list_item.Item28,
    BW=", ",
    BX=list_item.Item29,
    BY="]",
    BZ=", ",
    CA="[",
    CB=list_item.Item30,
    CC=", ",
    CD=list_item.Item31,
    CE=", ",
    CF=list_item.Item32,
    CG="]",
    CH=", ",
    CI="[",
    CJ=list_item.Item33,
    CK=", ",
    CL=list_item.Item34,
    CM=", ",
    CN=list_item.Item35,
    CO="]")
panel_3 = Panel(concatenate)
